# Grasshopper definition kwrap-2.gh (Grasshopper 0.9.76)
# plug-ins: Kangaroo2 Components

strips = Curve(<curve referenced from the Rhino model>)
symmetry = Integer(2)
form = Brep(<brep referenced from the Rhino model>)
arrpolar = PolarArray(Geometry=strips, Plane=PlaneXY(0, 0, 0), Count=symmetry, Angle=6.283185307)  # -> Geometry, Transform
divide = DivideCurve(Curve=arrpolar.Geometry, Count=48, Kinks=False)  # -> Points, Tangents, Parameters
mesh = MeshBrep(
    Brep=form,
    Settings={GridMaxCount=0, GridMinCount=16, JaggedSeams=False, MaxEdgeLength=0, MinEdgeLength=0.0001, MinTolerance=0, Refine=True, RefineAngle=0, RelativeTolerance=0.65, SimplePlanes=True, Tolerance=0})
item = ListItem(List=divide.Points, Index=0, Wrap=True)
pline = PolyLine(Vertices=divide.Points, Closed=False)
explode = Explode(Curve=pline, Recursive=True)  # -> Segments, Vertices
anchor = Anchor(Point=item, Strength=1000)
onmesh = OnMesh(Points=explode.Vertices, Mesh=mesh, Strength=0.01)
reset = Button()
shift = ShiftList(List=explode.Segments, Shift=1, Wrap=False)
sc = SphereCollide(Points=explode.Vertices, Radius=20, Strength=100)
length_line = LengthLine(Line=explode.Segments, Strength=10)
short = ShortestList(ListA=explode.Segments, ListB=shift, TrimMode=2)  # -> ListA, ListB
angle = Angle(LineA=short.ListA, LineB=short.ListB, RestAngle=0, Strength=1000)
grab = Grab(On=True, Strength=1, Range=3)  # -> Grab, Anchors
solver = Solver(
    GoalObjects=[angle, grab.Grab, onmesh, length_line, anchor, sc],
    Reset=reset,
    Restart=False,
    Parallel=True,
    Threshold=1e-15,
    Tolerance=0.01,
    AddCurrent=False,
    On=True)  # -> V, O
