# Grasshopper definition kwrap.gh (Grasshopper 0.9.76)
# plug-ins: Kangaroo2 Components

ledspermeter = Number(60)
originpoint = Point(<point referenced from the Rhino model>)
ledsperstrip = Number(64)
numstrips = Integer(24)
stripwidth = Number(10)
form = Brep(<brep referenced from the Rhino model>)
mesh = MeshBrep(
    Brep=form,
    Settings={GridMaxCount=0, GridMinCount=16, JaggedSeams=False, MaxEdgeLength=0, MinEdgeLength=0.0001, MinTolerance=0, Refine=True, RefineAngle=0, RelativeTolerance=0.65, SimplePlanes=True, Tolerance=0})
division = Division(A=1000, B=ledspermeter)
multiplication = Multiplication(A=ledsperstrip, B=division)
division_2 = Division(A=multiplication, B=stripwidth)
dom0 = Dom0(num=stripwidth)
arrpolar = PolarArray(Geometry=originpoint, Plane=PlaneXY(0, 0, 0), Count=numstrips, Angle=6.283185307)  # -> Geometry, Transform
dom = ConstructDomain(DomainStart=0, DomainEnd=multiplication)
meshcp = MeshClosestPoint(Point=arrpolar.Geometry, Mesh=mesh)  # -> Point, Index, Parameter
vec2pt = Vector2Pt(PointA=arrpolar.Geometry, PointB=meshcp.Point, Unitize=False)  # -> Vector, Length
xprod = CrossProduct(VectorA=Vector(0, 0, -1), VectorB=vec2pt.Vector, Unitize=False)  # -> Vector, Length
pl = ConstructPlane(Origin=arrpolar.Geometry, XAxis=xprod.Vector, YAxis=vec2pt.Vector)
rectangle = Rectangle(Plane=pl, XSize=dom0, YSize=dom, Radius=0)  # -> Rectangle, Length
mplane = MeshPlane(Boundary=rectangle.Rectangle, WidthCount=1, HeightCount=division_2)  # -> Mesh, Area
medges = MeshEdges(Mesh=mplane.Mesh)  # -> NakedEdges, InteriorEdges, NonManifoldEdges
demesh = DeconstructMesh(Mesh=mplane.Mesh)  # -> Vertices, Faces, Colours, Normals
multiplication_2 = Multiplication(A=stripwidth, B=0.5)
subset = SubList(List=demesh.Vertices, Domain=Domain(0, 3), Wrap=True)  # -> List, Index
anchor = Anchor(Point=subset.List, Strength=10)
sc = SphereCollide(Points=demesh.Vertices, Radius=multiplication_2, Strength=100)
length_line = LengthLine(Line=[medges.NakedEdges, medges.InteriorEdges], Strength=40)
coplanar_pairs = CoplanarPairs(M=mplane.Mesh, strength=15)
onmesh = OnMesh(Points=demesh.Vertices, Mesh=mesh, Strength=0.0008)
reset = Button()
grab = Grab(On=True, Strength=1, Range=3)  # -> Grab, Anchors
solver = Solver(
    GoalObjects=[grab.Grab, onmesh, length_line, anchor, sc, coplanar_pairs],
    Reset=reset,
    Restart=False,
    Parallel=True,
    Threshold=1e-15,
    Tolerance=0.01,
    AddCurrent=False,
    On=True)  # -> V, O
lng = ListLength(List=demesh.Vertices)  # -> flatten(Length)
partition = PartitionList(List=solver.V, Size=lng)
conmesh = ConstructMesh(Vertices=partition, Faces=demesh.Faces)
ribbons = Mesh(conmesh)

# ==== cluster Dom0
num = ClusterInput()
num_2 = Number(num)
multiplication = Multiplication(A=num_2, B=-0.5)
multiplication_2 = Multiplication(A=num_2, B=0.5)
dom = ConstructDomain(DomainStart=multiplication, DomainEnd=multiplication_2)
I = ClusterOutput(dom)

# ==== cluster CoplanarPairs
M = ClusterInput()
strength = ClusterInput()
demesh = DeconstructMesh(Mesh=M)  # -> Vertices, Faces, Colours, Normals
shift = ShiftList(List=demesh.Faces, Shift=1, Wrap=False)
short = ShortestList(ListA=demesh.Faces, ListB=shift, TrimMode=2)  # -> ListA, ListB
multiplication = Multiplication(A=strength, B=3)
deface = DeconstructFace(Face=short.ListB)  # -> CornerA, CornerB, CornerC, CornerD
deface_2 = DeconstructFace(Face=short.ListA)  # -> CornerA, CornerB, CornerC, CornerD
item = ListItem(List=demesh.Vertices, Index=deface.CornerB, Wrap=True)  # -> graft(Item)
item_2 = ListItem(List=demesh.Vertices, Index=deface.CornerC, Wrap=True)  # -> graft(Item)
item_3 = ListItem(List=demesh.Vertices, Index=deface_2.CornerA, Wrap=True)  # -> graft(Item)
item_4 = ListItem(List=demesh.Vertices, Index=deface_2.CornerB, Wrap=True)  # -> graft(Item)
item_5 = ListItem(List=demesh.Vertices, Index=deface_2.CornerC, Wrap=True)  # -> graft(Item)
item_6 = ListItem(List=demesh.Vertices, Index=deface.CornerA, Wrap=True)  # -> graft(Item)
item_7 = ListItem(List=demesh.Vertices, Index=deface.CornerD, Wrap=True)  # -> graft(Item)
item_8 = ListItem(List=demesh.Vertices, Index=deface_2.CornerD, Wrap=True)  # -> graft(Item)
coplanar = CoPlanar(Points=[item_3, item_4, item_5, item_8, item_6, item, item_2, item_7], Strength=strength)
hinge = Hinge(FoldStart=item_5, FoldEnd=item_8, Tip1=item_3, Tip2=item_7, RestAngle=0, Strength=multiplication)
colinear = CoLinear(Points=[item_3, item_5, item_6, item_2], Strength=strength)
C = ClusterOutput([coplanar, hinge, colinear])
